# Grasshopper definition Monkey.gh (Grasshopper 1.0.7)
# plug-ins: Monkey, Human, Robots

crv = Curve([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])
loft = Loft(Curves=crv, Options={Adjust=False, Closed=False, LoftEnds=0, LoftSimp=0, LoftType=0, Rebuild=10, Refit=0.01})
pt = Point(Point(-7.147788484, -23.50705651, 0))
crv_2 = Curve(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)
split = TextSplit()
crv_3 = Curve([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])
listseg = ListSegment(Number=1, Mode="First/Last")  # -> FirstNItems, MiddleItems, LastNItems
list = FlagFields({"Shoulder": 1, "Elbow": 2, "Wrist": 4}, selected=[])
crvcontain = CurvesContainment(Curves=crv_3)  # -> InteriorCurves, ExteriorCurves
dla = DLACrawl(
    Geo=loft,
    Point=pt,
    AttractorCurve=crv_2,
    SimulationAttribute="{ \"interval\": 10, \"maxStep\": 200 }",
    Scale=1,
    AttractorWeight=0.1)
number_slider = Slider(0, range=0..100)
target = CreateTarget(RobConf=list, IsCartesian=True)
crv_4 = Curve(crvcontain.InteriorCurves)
crv_5 = Curve(crvcontain.ExteriorCurves)
series = Series(Start=0, Step=1, Count=10)
visualizer = DLAVisualzier(DLALines=dla)  # -> Parameters, Thickness
sortbydir = SortByDirections(crv=[<geometry referenced from the Rhino model> x698])  # -> horizontal_2, vertical_2, other
listseg_2 = ListSegment(List=series, Number=1, Mode="Half")  # -> FirstNItems, MiddleItems, LastNItems
gradient = Gradient(
    LowerLimit=0,
    UpperLimit=1,
    Parameter=visualizer.Parameters,
    stops=[0: RGB(0, 98, 0), 0.25: RGB(81, 175, 17), 0.5: RGB(159, 198, 146), 0.75: RGB(170, 235, 41), 1: RGB(221, 255, 53)])
panel = Panel(listseg_2.FirstNItems)
panel_2 = Panel(listseg_2.MiddleItems)
panel_3 = Panel(listseg_2.LastNItems)
polymesh = PolylineMesh(PolylineSegment=0)
previewlw = CustomPreviewLineweights(Geometry=dla, Shader=gradient, Thickness=visualizer.Thickness, Absolute=False)

# ==== cluster SortByDirections: Sort list of individual crvs into horizontal and vertical
crv = ClusterInput()  # Individual curve to test verticality
crv_2 = Curve(crv)

# ---- group: Z Test
curvepoint = PointOnCurve(crv_2, parameter=1)
curvepoint_2 = PointOnCurve(crv_2, parameter=0)
pdecon = Deconstruct(Point=curvepoint_2)  # -> XComponent, YComponent, ZComponent
pdecon_2 = Deconstruct(Point=curvepoint)  # -> XComponent, YComponent, ZComponent
subtraction = Subtraction(A=pdecon.ZComponent, B=pdecon_2.ZComponent)
similar = Similarity(FirstNumber=subtraction, SecondNumber=Slider(0, range=0..100), Threshold=0.1)  # -> Similarity, AbsoluteDifference

# ----
dispatch = Dispatch(List=crv_2, DispatchPattern=similar.Similarity)  # -> ListA, ListB

# ---- group: X test
crv_3 = Curve(dispatch.ListB)
curvepoint_3 = PointOnCurve(crv_3, parameter=1)
curvepoint_4 = PointOnCurve(crv_3, parameter=0)
pdecon_3 = Deconstruct(Point=curvepoint_3)  # -> XComponent, YComponent, ZComponent
pdecon_4 = Deconstruct(Point=curvepoint_4)  # -> XComponent, YComponent, ZComponent
similar_2 = Similarity(FirstNumber=pdecon_4.XComponent, SecondNumber=pdecon_3.XComponent, Threshold=0.1)  # -> Similarity, AbsoluteDifference
dispatch_2 = Dispatch(List=crv_3, DispatchPattern=similar_2.Similarity)  # -> ListA, ListB

# ---- group: Y test
crv_4 = Curve(dispatch_2.ListA)
curvepoint_5 = PointOnCurve(crv_4, parameter=1)
curvepoint_6 = PointOnCurve(crv_4, parameter=0)
pdecon_5 = Deconstruct(Point=curvepoint_5)  # -> XComponent, YComponent, ZComponent
pdecon_6 = Deconstruct(Point=curvepoint_6)  # -> XComponent, YComponent, ZComponent
similar_3 = Similarity(FirstNumber=pdecon_6.YComponent, SecondNumber=pdecon_5.YComponent, Threshold=0.1)  # -> Similarity, AbsoluteDifference
dispatch_3 = Dispatch(List=crv_4, DispatchPattern=similar_3.Similarity)  # -> ListA, ListB

# ----
horizontal = Curve(dispatch.ListA)
vertical = Curve(dispatch_3.ListA)
else = Curve(dispatch_3.ListB)
other = ClusterOutput(else)  # Neither horizontal or vertical
vertical_2 = ClusterOutput(vertical)
horizontal_2 = ClusterOutput(horizontal)
